# Grasshopper definition E0.gh (Grasshopper 1.0.7)

expression = Expression(x=Slider(2, range=0..10), y=Slider(7, range=0..10), Expression="X *(7*Y)/2")
dom = ConstructDomain(DomainStart=Slider(2, range=0..10), DomainEnd=Slider(7, range=0..10))
rad = Radians(Degrees=Slider(90, range=0..100))
sinc = Sinc(Value=Slider(7, range=0..10))
division = Division(A=Slider(10, range=0..10), B=Slider(5, range=0..10))
addition = Addition(A=Slider(10, range=0..10), B=Slider(7, range=0..10))
subtraction = Subtraction(A=Slider(10, range=0..10), B=Slider(7, range=0..10))
multiplication = Multiplication(A=Slider(10, range=0..10), B=Slider(7, range=0..10))
pow = Power(A=Slider(3, range=0..10), B=Slider(8, range=0..10))
panel = Panel(rad)
deg = Degrees(Radians=panel)
panel_2 = Panel(deg)
panel_3 = Panel(addition)
panel_4 = Panel(subtraction)
panel_5 = Panel(multiplication)
panel_6 = Panel(division)
panel_7 = Panel(pow)
panel_8 = Panel(expression)
panel_9 = Panel(dom)
panel_10 = Panel(sinc)
crv = Curve(<curve referenced from the Rhino model>)
crv_2 = Curve(<curve referenced from the Rhino model>)

crv_3 = Curve(<curve referenced from the Rhino model>)
crv_4 = Curve(<curve referenced from the Rhino model>)
divide = DivideCurve(Curve=crv_3, Count=10, Kinks=False)  # -> Points, Tangents, Parameters
divide_2 = DivideCurve(Curve=crv_4, Count=10, Kinks=False)  # -> Points, Tangents, Parameters
rev = ReverseList(List=divide_2.Points)
ln = Line(StartPoint=divide.Points, EndPoint=rev)

divide_3 = DivideCurve(Curve=crv_2, Count=Slider(10, range=0..10), Kinks=False)  # -> Points, Tangents, Parameters
divide_4 = DivideCurve(Curve=crv, Count=Slider(8, range=0..10), Kinks=False)  # -> Points, Tangents, Parameters
panel_11 = Panel(divide_4.Points)
panel_12 = Panel(divide_3.Points)
short = ShortestList(ListA=panel_12, ListB=panel_11, TrimMode=2)  # -> ListA, ListB
long = LongestList(ListA=panel_12, ListB=panel_11, PaddingMode=2)  # -> ListA, ListB
crossref = CrossReference(ListA=panel_12, ListB=panel_11, CrossMode=1)  # -> ListA, ListB
ln_2 = Line(StartPoint=panel_12, EndPoint=panel_11)
ln_3 = Line(StartPoint=crossref.ListA, EndPoint=crossref.ListB)
ln_4 = Line(StartPoint=short.ListA, EndPoint=short.ListB)
ln_5 = Line(StartPoint=long.ListA, EndPoint=long.ListB)
