# Grasshopper definition E1.gh (Grasshopper 1.0.7)

sqgrid = Square(Plane=PlaneXY(0, 0, 0), Size=Slider(10, range=0..10), ExtentX=Slider(10, range=0..10), ExtentY=Slider(10, range=0..10))  # -> Cells, Points

pt = Point(<point referenced from the Rhino model>)
dist = Distance(PointA=sqgrid.Points, PointB=pt)
multiplication = Multiplication(A=dist, B=Slider(0.03, range=0..0.1))

pt_2 = Point(<point referenced from the Rhino model>)
dist_2 = Distance(PointA=sqgrid.Points, PointB=pt_2)
multiplication_2 = Multiplication(A=dist_2, B=Slider(0.03, range=0..0.1))

pt_3 = Point(<point referenced from the Rhino model>)
dist_3 = Distance(PointA=sqgrid.Points, PointB=pt_3)
multiplication_3 = Multiplication(A=dist_3, B=Slider(0.03, range=0..0.1))

box = CenterBox(Base=sqgrid.Points, X=multiplication, Y=multiplication_2, Z=multiplication_3)
