# Grasshopper definition E2.gh (Grasshopper 1.0.7)

cell_size = Slider(1, range=0..10)
cells_x_direction = Slider(10, range=0..20)
cells_y_direction = Slider(10, range=0..20)
sqgrid = Square(Plane=PlaneXY(0, 0, 0), Size=cell_size, ExtentX=cells_x_direction, ExtentY=cells_y_direction)  # -> Cells, Points
area = Area(Geometry=sqgrid.Cells)  # -> Area, Centroid
pt = Point(area.Centroid)
points = PointList(Points=pt, Size=Slider(0.5, range=0..10))
polygon = Polygon(Plane=pt, Radius=Slider(0.66, range=0..1), Segments=Slider(6, range=3..10), FilletRadius=Slider(0.06, range=0..1))  # -> Polygon, Length
degree_increment = Slider(51, range=0..100)
lng = ListLength(List=polygon.Polygon)
series = Series(Start=0, Step=degree_increment, Count=lng)
rotate = Rotate(Geometry=polygon.Polygon, Angle=degrees(series), Plane=pt)  # -> Geometry, Transform
boundary = BoundarySurfaces(Edges=rotate.Geometry)
