# Grasshopper definition E3.gh (Grasshopper 1.0.7)

crv = Curve([<curve referenced from the Rhino model> x4])
pt = Point([<point referenced from the Rhino model> x100])
patch = Patch(Curves=crv, Points=pt, Spans=Slider(60, range=0..100), Flexibility=Slider(30, range=0..100), Trim=True)
contour = Contour(Shape=patch, Point=Point(0, 0, 0), Direction=Vector(0, 0, 1), Distance=Slider(1, range=0..100))
crv_2 = Curve(contour)
