# Grasshopper definition E4.gh (Grasshopper 1.0.7)
# plug-ins: Bifocals

pt = Point(<point referenced from the Rhino model>)
recgrid = Rectangular(
    Plane=pt,
    SizeX=Slider(5, range=0..10),
    SizeY=Slider(3, range=0..10),
    ExtentX=Slider(84, range=0..100),
    ExtentY=Slider(100, range=0..100))  # -> flatten(Cells), Points
lng = ListLength(List=recgrid.Cells)
bbox = BoundingBox(Content=recgrid.Cells, Plane=PlaneXY(0, 0, 0))  # -> Box, Box_2

# ---- group: Geometry 1
geo = Geometry(<curve referenced from the Rhino model>)
bbox_2 = BoundingBox(Content=geo, Plane=PlaneXY(0, 0, 0), UnionBox=True)  # -> Box, Box_2
geo_2 = Geometry(graft(geo))
recmap = RectangleMapping(Geometry=geo_2, Source=bbox_2.Box_2, Target=bbox.Box_2)  # -> Geometry, Transform
geo_3 = Geometry(recmap.Geometry)

# ----
dom = ConstructDomain(DomainStart=Slider(-0.49, range=-1000..1000), DomainEnd=Slider(10, range=0..10))
random = Random(Range=dom, Number=lng, Seed=Slider(56, range=0..100))
int = Integer(random)
p_n_c = PickNChoose(Pattern=int, Stream0=geo_3)
