# Grasshopper definition day_2.gh (Grasshopper 1.0.7)

# ----
# DIVIDING THE SURFACE(ISOTRIM)
rectangle = Rectangle(Plane=PlaneXY(0, 0, 0), XSize="-50000 TO 50000", YSize="-50000 TO 50000", Radius=0)  # -> Rectangle, Length
srf = Surface(rectangle.Rectangle)
divide = DivideDomain²(Domain=srf, UCount="3", VCount="3")
subsrf = Isotrim(Surface=srf, Domain=divide)

# ----
# SITE SELECTION
number_slider = Slider(4, range=0..8)
item = ListItem(List=subsrf, Index=number_slider, Wrap=True)

area = Area(Geometry=item)  # -> Area, Centroid
series = Series(Start=0, Step="4500", Count="20")
Z = UnitZ(Factor=1)
amp = Amplitude(Vector=Z, Amplitude=series)
move = Move(Geometry=area.Centroid, Motion=amp)  # -> Geometry, Transform
rectangle_2 = Rectangle(Plane=move.Geometry, XSize="- 12000  TO 12000", YSize="- 12000  TO 12000", Radius=0)  # -> Rectangle, Length

lng = ListLength(List=rectangle_2.Rectangle)
# ADDING ROTATION TO THE TOWER
range = Range(Domain=Domain(0, 1), Steps=expr("x-1", lng))
graph = GraphMapper(range, x0=0, x1=1, y0=0, y1=1, container_name="Sine", Equation_px=[0, 0.5271739364], Equation_py=[0, 1])
bnd = Bounds(Numbers=graph)
dom = ConstructDomain(DomainStart=Slider(0, range=0..45), DomainEnd=Slider(29, range=0..90))
remap = RemapNumbers(Value=graph, Source=bnd, Target=dom)  # -> Mapped, Clipped
rotate = Rotate(Geometry=rectangle_2.Rectangle, Angle=degrees(remap.Mapped), Plane=move.Geometry)  # -> Geometry, Transform

lng_2 = ListLength(List=rotate.Geometry)
range_2 = Range(Domain=Domain(0, 1), Steps=expr("x-1", lng_2))
# SCALING OF THE FLOOR PLATES
graph_2 = GraphMapper(range_2, x0=0, x1=1, y0=0, y1=1, container_name="Sine", Equation_px=[0, 0.5046651959], Equation_py=[0, 1])
bnd_2 = Bounds(Numbers=graph_2)
dom_2 = ConstructDomain(DomainStart=Slider(0.7, range=0.7..1.2), DomainEnd=Slider(1.2, range=0.7..1.2))
remap_2 = RemapNumbers(Value=graph_2, Source=bnd_2, Target=dom_2)  # -> Mapped, Clipped
scale = Scale(Geometry=rotate.Geometry, Center=move.Geometry, Factor=remap_2.Mapped)  # -> Geometry, Transform

panel = Panel("http://climate.onebuilding.org/WMO_Region_6_Europe/ISR_Israel/JM_Yerushalayim/ISR_JM_Jerusalem.Center.401830_TMYx.zip")
fillet = Fillet(Curve=scale.Geometry, Radius="5000")
loft = Loft(Curves=fillet, Options={Adjust=False, Closed=False, LoftEnds=0, LoftSimp=1, LoftType=3, Rebuild=50, Refit=0.01})
cap = CapHoles(Brep=loft)
downloadepw = LBDownloadWeather(weather_URL=panel)  # -> epw_file, stat_file, ddy_file; plug-in component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
importloc = LBImportLocation(epw_file=downloadepw.epw_file)  # -> location; plug-in component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
analysisperiod = LBAnalysisPeriod(start_month=1, start_day=1, start_hour=0)  # -> period, hoys, dates; plug-in component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
importepw = LBImportEPW(epw_file=downloadepw.epw_file)  # -> location, dry_bulb_temperature, dew_point_temperature, relative_humidity, wind_speed, wind_direction, direct_normal_rad, diffuse_horizontal_rad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; plug-in component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
analysisperiod_2 = LBAnalysisPeriod(start_month=1, start_day=1, start_hour=0)  # -> period, hoys, dates; plug-in component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
hoy = LBCalculateHOY()  # -> flatten(hoy), flatten(doy), flatten(date); plug-in component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
pipeline = GeometryPipeline(
    GroupByLayer=False,
    GroupByType=False,
    IncludeHidden=True,
    IncludeLocked=True,
    LayerFilter="Context",
    NameFilter="*",
    SublayerFiltering=True,
    TypeFilter=1073741848)
sunpath = LBSunPath(location=importepw.location, hoys=analysisperiod_2.hoys, scale="1.5")  # -> report, vectors, altitudes, azimuths, hoys, sun_pts, analemma, daily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; plug-in component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
brep = Brep(pipeline)
sph = Sphere(Base=sunpath.sun_pts, Radius="5000")
directsunhours = LBDirectSunHours(
    vectors=flatten(sunpath.vectors),
    geometry=flatten([brep, srf]),
    context=flatten(cap),
    grid_size="3000",
    offset_dist="20",
    run=Toggle(True))  # -> report, points, results, mesh, legend, title, int_mtx; plug-in component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
ma = MassAddition(Input=directsunhours.results)  # -> Result, PartialResults
panel_2 = Panel(ma.Result)
