# Grasshopper definition day_3_1.gh (Grasshopper 1.0.7)
# plug-ins: Pufferfish, Wallacei

# ----
# BLOCK SIZE OF 113M
panel = Panel("- 56500 TO 56500")
rectangle = Rectangle(Plane=PlaneXY(0, 0, 0), XSize=panel, YSize=panel, Radius=0)  # -> Rectangle, Length

fillet = Fillet(Curve=rectangle.Rectangle, Radius="20000")
explode = Explode(Curve=fillet, Recursive=True)  # -> Segments, Vertices

# ----
# STREET WIDTH
polyline = PolyLine(Vertices=explode.Vertices, Closed=False)
offset_curve = OffsetCurve(Curve=polyline, Distance=expr("-X", "10000"), Plane=PlaneXY(0, 0, 0), Corners=1)

# ----
# COURTYARD DIMENSIONS
panel_2 = Panel("20000")
addition = Addition(A="10000", B=panel_2)
offset_curve_2 = OffsetCurve(Curve=rectangle.Rectangle, Distance=expr("-X", addition), Plane=PlaneXY(0, 0, 0), BothSides=False, Kinks=0, CapType=1)

explode_2 = Explode(Curve=offset_curve_2, Recursive=True)  # -> Segments, Vertices
perp_frames = PerpFrames(Curve=explode_2.Segments, Count="4", Align=True)  # -> Frames, Parameters
deconstruct_plane = DeconstructPlane(Plane=perp_frames.Frames)  # -> Origin, XAxis, YAxis, ZAxis
line_sdl = LineSDL(Start=perp_frames.Frames, Direction=deconstruct_plane.YAxis, Length="20000")  # -> flatten(Line)
shatter = Shatter(Curve=explode_2.Segments, Parameters=flatten(perp_frames.Parameters))  # -> flatten(Segments)
curve_curve = CurveCurve(CurveA=line_sdl, CurveB=offset_curve)  # -> Points, flatten(ParamsA), flatten(ParamsB)
shatter_2 = Shatter(Curve=offset_curve, Parameters=curve_curve.ParamsB)
length = Length(Curve=shatter_2)  # -> flatten(Length)
round = Round(Number=length)  # -> Nearest, Floor, Ceiling
list_item = ListItem(List=round.Nearest, Index=0, Wrap=True)
smaller_than = SmallerThan(FirstNumber=list_item, SecondNumber=round.Nearest)  # -> SmallerThan, OrEqualTo
discontinuity = Discontinuity(Curve=offset_curve_2, Level=1)  # -> Points, Parameters
dispatch = Dispatch(List=shatter_2, DispatchPattern=smaller_than.SmallerThan)  # -> ListA, ListB
shift_list = ShiftList(List=discontinuity.Points, Shift=Slider(1, range=0..4), Wrap=True)  # -> graft(List)
data = Data(dispatch.ListA)
data_2 = Data(dispatch.ListB)
weave = Weave(Pattern=[0, 1], Stream0=graft(data_2), Stream1=graft(shatter), NullGaps=False)  # -> simplify(Weave)
discontinuity_2 = Discontinuity(Curve=data, Level=1)  # -> Points, Parameters
merge = Merge(Data1=discontinuity_2.Points, Data2=shift_list)
loft = Loft(Curves=weave, Options={Adjust=False, Closed=False, LoftEnds=0, LoftSimp=0, LoftType=0, Rebuild=10, Refit=0.01})
polyline_2 = PolyLine(Vertices=merge, Closed=True)
boundary_surfaces = BoundarySurfaces(Edges=polyline_2)
merge_2 = Merge(Data1=boundary_surfaces, Data2=loft)  # -> flatten(Result)
deconstruct_brep = DeconstructBrep(Brep=merge_2)  # -> Faces, Edges, Vertices
area = Area(Geometry=merge_2)  # -> Area, Centroid
polyline_3 = PolyLine(Vertices=deconstruct_brep.Vertices, Closed=True)
rectangle_2 = Rectangle(Plane=area.Centroid, XSize="-2000 TO 2000", YSize="-2000 TO 2000", Radius=0)  # -> Rectangle, Length
merge_3 = Merge(Data1=graft(rectangle_2.Rectangle), Data2=polyline_3)
boundary_surfaces_2 = BoundarySurfaces(Edges=merge_3)
unit_z = UnitZ(Factor="4000")
extrude = Extrude(Base=boundary_surfaces_2, Direction=unit_z)  # -> flatten(Extrusion)
wlc_1 = Slider(16, range=0..19)
unit_z_2 = UnitZ(Factor=1)
cull_index = CullIndex(List=extrude, Indices=wlc_1, Wrap=True)
wlc_2 = GenePool(Decimals=0, Maximum=10, Minimum=1, Value=[1, 10, 9, 10, 2, 2, 8, 7, 5, 9, 4, 10, 10, 10, 10, 9, 8, 1, 9])

# ----
# Energy plus weather format
panel_3 = Panel("http://climate.onebuilding.org/WMO_Region_6_Europe/ISR_Israel/JM_Yerushalayim/ISR_JM_Jerusalem.Center.401830_TMYx.zip")
downloadepw = LBDownloadWeather(weather_URL=panel_3)  # -> epw_file, stat_file, ddy_file; plug-in component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

amplitude = Amplitude(Vector=unit_z_2, Amplitude="4000")
linear_array = LinearArray(Geometry=simplify(graft(cull_index)), Direction=amplitude, Count=simplify(graft(wlc_2)))  # -> Geometry, Transform
panel_4 = Panel("10")
surface = Surface(offset_curve_2)
# F1 to maximse the sun exposure on the buldings
# F2 to maximse the sun exposure in the courtyard
# F3 to maximise the total area of the blocks
data_3 = Data(flatten(linear_array.Geometry))
analysisperiod = LBAnalysisPeriod(start_month=1, start_day=1, start_hour=0)  # -> period, hoys, dates; plug-in component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
importloc = LBImportLocation(epw_file=downloadepw.epw_file)  # -> location; plug-in component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
area_2 = Area(Geometry=data_3)  # -> Area, Centroid
round_2 = Round(Number=area_2.Area)  # -> Nearest, Floor, Ceiling
importepw = LBImportEPW(epw_file=downloadepw.epw_file)  # -> location, dry_bulb_temperature, dew_point_temperature, relative_humidity, wind_speed, wind_direction, direct_normal_rad, diffuse_horizontal_rad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; plug-in component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
mass_addition = MassAddition(Input=round_2.Nearest)  # -> Result, PartialResults
one_over_x = OneOverX(Value=mass_addition.Result)
hoy = LBCalculateHOY()  # -> flatten(hoy), flatten(doy), flatten(date); plug-in component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
analysisperiod_2 = LBAnalysisPeriod(start_month="6", start_day="21", start_hour="11", end_month="6", end_day="21", end_hour="14")  # -> period, hoys, dates; plug-in component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
wlc_fc1_maximise_bloack_area = Number(one_over_x)
gene_pool_and_slider_shuffler = GenePoolAndSliderShuffler(BooleanButton=Button())
sunpath = LBSunPath(location=importepw.location, hoys=analysisperiod_2.hoys, scale="1.5")  # -> report, vectors, altitudes, azimuths, hoys, sun_pts, analemma, daily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; plug-in component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
sphere = Sphere(Base=sunpath.sun_pts, Radius="5000")
directsunhours = LBDirectSunHours(
    vectors=flatten(sunpath.vectors),
    geometry=flatten(surface),
    context=flatten(linear_array.Geometry),
    grid_size="3000",
    offset_dist="20",
    run=Toggle(True))  # -> report, points, results, mesh, legend, title, int_mtx; plug-in component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
directsunhours_2 = LBDirectSunHours(
    vectors=flatten(sunpath.vectors),
    geometry=flatten(data_3),
    context=flatten(data_3),
    grid_size="3000",
    offset_dist="20",
    run=Toggle(True))  # -> report, points, results, mesh, legend, title, int_mtx; plug-in component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
mass_addition_2 = MassAddition(Input=directsunhours.results)  # -> Result, PartialResults
mass_addition_3 = MassAddition(Input=directsunhours_2.results)  # -> Result, PartialResults
one_over_x_2 = OneOverX(Value=mass_addition_2.Result)
data_4 = Data(data_3)
one_over_x_3 = OneOverX(Value=mass_addition_3.Result)
merge_4 = Merge(Data1=data_4, Data2=boundary_surfaces)  # -> flatten(Result)
wlc_fc2_maximise_sunlight_courtyard = Number(one_over_x_2)
wlc_fc3_maximise_sunlight_on_blocks = Number(one_over_x_3)
wallacei_x = WallaceiX(
    Genes=[wlc_1, wlc_2],
    Objectives=[wlc_fc2_maximise_sunlight_courtyard, wlc_fc3_maximise_sunlight_on_blocks, wlc_fc1_maximise_bloack_area],
    Phenotype=merge_4,
    allFitness="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",
    allFrontIdx="33|30;34|30;35|47;36|14;36|20;36|26;37|11;37|30;39|11;39|12;39|15;39|19;40|2;40|16;40|19;40|23;40|33;41|27;41|32;41|34;41|41;41|47;41|48;42|8;42|10;42|27;42|31;42|48;43|4;43|7;43|8;43|12;43|22;43|26;43|37;43|38;43|43;44|12;44|14;44|21;44|22;44|23;44|26;44|39;44|40;44|41;44|44;44|48;45|1;45|3;45|9;45|10;45|11;45|12;45|13;45|15;45|22;45|28;45|31;45|32;45|33;45|41;45|47;46|0;46|7;46|8;46|13;46|21;46|22;46|26;46|39;46|43;46|44;46|45;46|48;47|8;47|9;47|13;47|24;47|36;47|47;48|0;48|19;48|25;48|30;48|32;48|37;48|38;48|39;48|47;49|3;49|9;49|16;49|19;49|23;49|38;49|42;49|44;49|48;49|49",
    allGenomes="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",
    curFrontIdx="49|0;49|1;49|2;49|3;49|4;49|5;49|6;49|7;49|8;49|9;49|10;49|11;49|12;49|13;49|14;49|15;49|16;49|17;49|18;49|19;49|20;49|21;49|22;49|23;49|24;49|25;49|26;49|27;49|28;49|29;49|30;49|31;49|32;49|33;49|34;49|35;49|36;49|37;49|38;49|39;49|40;49|41;49|42;49|43;49|44;49|45;49|46;49|47;49|48;49|49",
    curFrontIdxSave="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",
    popGen="50,50",
    total="7132250",
    wlcDone=True)  # -> WallaceiGenomes, FitnessValues, Data, Phenotypes
decode_phenotype = DecodePhenotype(WallaceiPhenotype=wallacei_x.Phenotypes)  # -> GeometriesList, MeshesList, NumbersList, TextList

# ----
# In your presentastions:
# 
# 1.show the best and worst solutions for the each fitness criteria.
# 2. write a few words on these solutions.
# 3. Show the pareto front with the graphs.
panel_5 = Panel("1000")
# pareto front solutions
distribute_to_grid = DistributeToGrid(
    FitnessValues=wallacei_x.FitnessValues,
    WallaceiPhenotypes=wallacei_x.Phenotypes,
    SizeOfTheGridInTheXDirection="150000",
    SizeOfTheGridInTheYDirection="150000",
    SizeOfTheTexts=panel_5,
    OutputOptions=0)  # -> DistributedFitnessValues, DistributedData, DistributedGeometries, DistributedMeshes, DistributedNumbers, GridLocations
unit_x = UnitX(Factor=1)
unit_y = UnitY(Factor=1)
panel_6 = Panel("""10000
20000""")
amplitude_2 = Amplitude(Vector=unit_y, Amplitude=panel_6)  # -> expr("-x", Vector)
data_5 = Data(distribute_to_grid.DistributedGeometries)
data_6 = Data(distribute_to_grid.GridLocations)
move = Move(Geometry=data_6, Motion=amplitude_2)  # -> Geometry, Transform
merge_5 = Merge(Data1=data_6, Data2=move.Geometry)  # -> simplify(Result)

one_over_x_4 = OneOverX(Value=distribute_to_grid.DistributedFitnessValues)

text_tag_3d = TextTag3D(Location=merge_5, Text=one_over_x_4, Size="8000", Justification=3)
