# Grasshopper definition Class_1.gh (Grasshopper 1.0.7)
# plug-ins: Bifocals

construct_domain = ConstructDomain(DomainStart="0", DomainEnd="10")
range = Range(Domain=construct_domain, Steps="30")
construct_point = ConstructPoint(XCoordinate=0, YCoordinate=range, ZCoordinate=0)

construct_point_2 = ConstructPoint(XCoordinate=Slider(0, range=0..20), YCoordinate=Slider(0, range=0..20), ZCoordinate=Slider(0, range=0..20))

series = Series(Start=0, Step="2", Count=10)
panel = Panel(series)

construct_domain_2 = ConstructDomain(DomainStart="-2", DomainEnd="2")
range_2 = Range(Domain=construct_domain_2, Steps="30")
evaluate = Evaluate(Expression="x^2", x=range_2)
construct_point_3 = ConstructPoint(XCoordinate=range_2, YCoordinate=evaluate, ZCoordinate=0)

curve = Curve(<curve referenced from the Rhino model>)
control_points = ControlPoints(Curve=curve)  # -> Points, Weights, Knots
domain = Domain(curve)
polyline = PolyLine(Vertices=control_points.Points, Closed=False)
length = Length(Curve=polyline)
panel_2 = Panel(length)

# ----
# divide surface
panel_3 = Panel("10")
rectangle = Rectangle(Plane=PlaneXY(0, 0, 0), XSize=panel_3, YSize="10", Radius=0)  # -> Rectangle, Length
boundary_surfaces = BoundarySurfaces(Edges=rectangle.Rectangle)
divide_surface = DivideSurface(Surface=boundary_surfaces, UCount=Slider(20, range=0..20), VCount=Slider(20, range=0..20))  # -> Points, Normals, Parameters
param_viewer = ParamViewer(divide_surface.Points)
panel_4 = Panel("""true 
false""")
point_list = PointList(Points=divide_surface.Points, Size=".3")
dispatch = Dispatch(List=divide_surface.Points, DispatchPattern=panel_4)  # -> ListA, ListB
unit_z = UnitZ(Factor=1)
data = Data(dispatch.ListA)
data_2 = Data(dispatch.ListB)
amplitude = Amplitude(Vector=unit_z, Amplitude=Slider(0.26, range=0..20))
unit_z_2 = UnitZ(Factor=Slider(0.49, range=0..20))  # -> expr("-x", UnitVector)
move = Move(Geometry=data, Motion=unit_z_2)  # -> Geometry, Transform
move_2 = Move(Geometry=data_2, Motion=amplitude)  # -> Geometry, Transform
merge = Merge(Data1=move.Geometry, Data2=move_2.Geometry)  # -> simplify(Result)
weave = Weave(Pattern=[0, 1], Stream0=move.Geometry, Stream1=move_2.Geometry, NullGaps=False)
point_list_2 = PointList(Points=merge, Size=".1")
point_list_3 = PointList(Points=weave, Size=".1")
nurbs_curve = NurbsCurve(Vertices=weave, Degree=3, Periodic=False)  # -> Curve, Length, Domain
panel_5 = Panel(nurbs_curve.Curve)
loft = Loft(
    Curves=flatten(nurbs_curve.Curve),
    Options={Adjust=False, Closed=False, LoftEnds=0, LoftSimp=0, LoftType=0, Rebuild=10, Refit=0.01})
panel_6 = Panel(loft)

construct_domain_3 = ConstructDomain(DomainStart="0", DomainEnd="1")
range_3 = Range(Domain="0 to 1", Steps="30")
graph_mapper = GraphMapper(range_3, x0=0, x1=1, y0=0, y1=1, Cx=0.4291092157, Cy=0.7511509657, container_name="Conic")
construct_point_4 = ConstructPoint(XCoordinate=range_3, YCoordinate=graph_mapper, ZCoordinate=0)

series_2 = Series(Start=0, Step=1, Count=10)
series_3 = Series(Start=0, Step=1, Count=10)
construct_point_5 = ConstructPoint(XCoordinate=0, YCoordinate=0, ZCoordinate=series_3)
construct_point_6 = ConstructPoint(XCoordinate=0, YCoordinate="3", ZCoordinate=series_2)
point_list_4 = PointList(Points=construct_point_5, Size=".3")
point_list_5 = PointList(Points=construct_point_6, Size=".3")
line = Line(StartPoint=construct_point_5, EndPoint=graft(construct_point_6))
panel_7 = Panel(line)

construct_domain_4 = ConstructDomain(DomainStart="0", DomainEnd=expr("x", Slider(2, range=0..10)))
panel_8 = Panel(evaluate)

series_4 = Series(Start=0, Step=1, Count=Slider(20, range=0..20))
construct_point_7 = ConstructPoint(XCoordinate=graft(series_4), YCoordinate=series_4, ZCoordinate=0)  # -> simplify(Point)
point_list_6 = PointList(Points=construct_point_7, Size=".3")
flatten_tree = FlattenTree(Tree=construct_point_7, Path="{0}")
point = Point(<point referenced from the Rhino model>)
point_2 = Point(Point(8, 9, 0))
distance = Distance(PointA=point_2, PointB=flatten_tree)
panel_9 = Panel(distance)
number_slider = Slider(4, range=0..100)
panel_10 = Panel("""0
3
6""")

bounds = Bounds(Numbers=distance)
remap_numbers = RemapNumbers(Value=distance, Source=bounds, Target=Domain(0, 1))  # -> Mapped, Clipped
unit_z_3 = UnitZ(Factor=1)
graph_mapper_2 = GraphMapper(
    remap_numbers.Mapped,
    x0=0,
    x1=1,
    y0=0,
    y1=1,
    container_name="Sine",
    Equation_px=[0, 0.1693999767],
    Equation_py=[0, 0.9697583914])
construct_domain_5 = ConstructDomain(DomainStart=expr("-x", Slider(0.92, range=0..10)), DomainEnd=Slider(0.77, range=0..10))
bounds_2 = Bounds(Numbers=graph_mapper_2)
remap_numbers_2 = RemapNumbers(Value=graph_mapper_2, Source=bounds_2, Target=construct_domain_5)  # -> Mapped, Clipped
amplitude_2 = Amplitude(Vector=unit_z_3, Amplitude=remap_numbers_2.Mapped)
move_3 = Move(Geometry=flatten_tree, Motion=amplitude_2)  # -> Geometry, Transform

interpolate = Interpolate(Vertices=move_3.Geometry, Degree=3, Periodic=False, KnotStyle=1)  # -> Curve, Length, Domain
unflatten_tree = UnflattenTree(Tree=move_3.Geometry, Guide=construct_point_7)
patch = Patch(Points=move_3.Geometry, Spans=20, Flexibility=1, Trim=True)
partition_list = PartitionList(List=move_3.Geometry, Size="20")
flip_matrix = FlipMatrix(Data=unflatten_tree)
interpolate_2 = Interpolate(Vertices=unflatten_tree, Degree=3, Periodic=False, KnotStyle=1)  # -> Curve, Length, Domain
interpolate_3 = Interpolate(Vertices=flip_matrix, Degree=3, Periodic=False, KnotStyle=1)  # -> Curve, Length, Domain
point_list_7 = PointList(Points=unflatten_tree, Size=".5")
panel_11 = Panel(unflatten_tree)
point_list_8 = PointList(Points=flip_matrix, Size=".5")
loft_2 = Loft(
    Curves=flatten(interpolate_2.Curve),
    Options={Adjust=False, Closed=False, LoftEnds=0, LoftSimp=0, LoftType=0, Rebuild=10, Refit=0.01})
pipe = Pipe(Curve=[interpolate_2.Curve, interpolate_3.Curve], Radius=".1", Caps=0)
divide_domain² = DivideDomain²(Domain=loft_2, UCount=10, VCount=10)
isotrim = Isotrim(Surface=loft_2, Domain=divide_domain²)
panel_12 = Panel(isotrim)
sub_list = SubList(List=isotrim, Domain="20 to 40", Wrap=True)  # -> List, Index
split_list = SplitList(List=isotrim, Index="49")  # -> ListA, ListB
list_length = ListLength(List=isotrim)
list_item = ListItem(List=isotrim, Index=panel_10, Wrap=True)
data_3 = Data(split_list.ListA)
data_4 = Data(split_list.ListB)
panel_14 = Panel(list_length)

range_4 = Range(Domain=Domain(0, 1), Steps=10)
graph_mapper_3 = GraphMapper(
    range_4,
    x0=0,
    x1=1,
    y0=0,
    y1=1,
    container_name="Bezier",
    cpx=[0, 0.6123162508, 0.5751558542, 1],
    cpy=[0, 0, 0.6194342971, 1])
# graph mapper to move points
construct_point_8 = ConstructPoint(XCoordinate=0, YCoordinate=range_4, ZCoordinate=0)
unit_z_4 = UnitZ(Factor=1)

bounds_3 = Bounds(Numbers=graph_mapper_3)
remap_numbers_3 = RemapNumbers(Value=graph_mapper_3, Source=bounds_3, Target=construct_domain_4)  # -> Mapped, Clipped

amplitude_3 = Amplitude(Vector=unit_z_4, Amplitude=remap_numbers_3.Mapped)
move_4 = Move(Geometry=construct_point_8, Motion=amplitude_3)  # -> Geometry, Transform
line_2 = Line(StartPoint=construct_point_8, EndPoint=move_4.Geometry)
loft_3 = Loft(Curves=line_2, Options={Adjust=False, Closed=False, LoftEnds=0, LoftSimp=0, LoftType=0, Rebuild=10, Refit=0.01})
