# Grasshopper definition Class_1.gh (Grasshopper 1.0.7)
# plug-ins: Bifocals

construct_domain = ConstructDomain(DomainStart="0", DomainEnd="10")
range = Range(Domain=construct_domain, Steps="30")
construct_point = ConstructPoint(XCoordinate=0, YCoordinate=range, ZCoordinate=0)

construct_point_2 = ConstructPoint(XCoordinate=Slider(0, range=0..20), YCoordinate=Slider(0, range=0..20), ZCoordinate=Slider(0, range=0..20))

series = Series(Start=0, Step="2", Count=10)
panel = Panel(series)

construct_domain_2 = ConstructDomain(DomainStart="-2", DomainEnd="2")
range_2 = Range(Domain=construct_domain_2, Steps="30")
evaluate = Evaluate(Expression="x^2", x=range_2)
construct_point_3 = ConstructPoint(XCoordinate=range_2, YCoordinate=evaluate, ZCoordinate=0)

curve = Curve(<curve referenced from the Rhino model>)
control_points = ControlPoints(Curve=curve)  # -> Points, Weights, Knots
domain = Domain(curve)
polyline = PolyLine(Vertices=control_points.Points, Closed=False)
length = Length(Curve=polyline)
panel_2 = Panel(length)

construct_domain_3 = ConstructDomain(DomainStart="-2", DomainEnd="2")
range_3 = Range(Domain=construct_domain_3, Steps="30")
graph_mapper = GraphMapper(range_3, x0=0, x1=1, y0=0, y1=1, Cx=0.4291092157, Cy=0.7511509657, container_name="Conic")
construct_point_4 = ConstructPoint(XCoordinate=range_3, YCoordinate=graph_mapper, ZCoordinate=0)

# ----
# divide surface
panel_3 = Panel("10")
rectangle = Rectangle(Plane=PlaneXY(0, 0, 0), XSize=panel_3, YSize="10", Radius=0)  # -> Rectangle, Length
boundary_surfaces = BoundarySurfaces(Edges=rectangle.Rectangle)
divide_surface = DivideSurface(Surface=boundary_surfaces, UCount=Slider(20, range=0..20), VCount=Slider(20, range=0..20))  # -> Points, Normals, Parameters
param_viewer = ParamViewer(divide_surface.Points)
panel_4 = Panel("""true 
false""")
point_list = PointList(Points=divide_surface.Points, Size=".3")
dispatch = Dispatch(List=divide_surface.Points, DispatchPattern=panel_4)  # -> ListA, ListB
unit_z = UnitZ(Factor=1)
data = Data(dispatch.ListA)
data_2 = Data(dispatch.ListB)
amplitude = Amplitude(Vector=unit_z, Amplitude=Slider(0.26, range=0..20))
unit_z_2 = UnitZ(Factor=Slider(0.49, range=0..20))  # -> expr("-x", UnitVector)
move = Move(Geometry=data, Motion=unit_z_2)  # -> Geometry, Transform
move_2 = Move(Geometry=data_2, Motion=amplitude)  # -> Geometry, Transform
merge = Merge(Data1=move.Geometry, Data2=move_2.Geometry)  # -> simplify(Result)
weave = Weave(Pattern=[0, 1], Stream0=move.Geometry, Stream1=move_2.Geometry, NullGaps=False)
point_list_2 = PointList(Points=merge, Size=".1")
point_list_3 = PointList(Points=weave, Size=".1")
nurbs_curve = NurbsCurve(Vertices=weave, Degree=3, Periodic=False)  # -> Curve, Length, Domain
panel_5 = Panel(nurbs_curve.Curve)
loft = Loft(
    Curves=flatten(nurbs_curve.Curve),
    Options={Adjust=False, Closed=False, LoftEnds=0, LoftSimp=0, LoftType=0, Rebuild=10, Refit=0.01})
panel_6 = Panel(loft)

panel_7 = Panel(evaluate)
